# Dynamo graph OT_LOD_exportParameterToExcel_r00.dyn (Dynamo 1.3.2.2480)

# group: parametri FAMIGLIE CARICABILI -->EXCEL
file_path = Filename(".\LOD_CARICABILI.XLSX")
categories = Categories("GenericModel")
boolean = BoolSelector(true)

# group: parametri FAMIGLIE DI SISTEMA --> EXCEL
file_path_2 = Filename(".\LOD_SISTEMA.XLSX")
element_types = ElementTypes("Wall")
boolean_2 = BoolSelector(true)
ot_system_family = Custom[OT_SYSTEM FAMILY_ParametersToExcel](categoria=element_types, getValues=boolean_2)  # unwired: filePath

directory_path = Directory("D:\0_CLIENTI\UNI\_OT_WORK\PARAMETERS_DATA")
string_from_object = FromObject(categories)
code_block = CodeBlock { "."; "_"; }
replace = String.Replace(str=string_from_object, searchFor=code_block.out0, replaceWith=code_block.out1)
code_block_2 = CodeBlock(PERCORSO=directory_path, NOMEFILE=replace) { PERCORSO+"\\"+NOMEFILE+".xlsx"; }
watch = Watch(code_block_2)

# group (continued): parametri FAMIGLIE CARICABILI -->EXCEL
ot_components_family = Custom[OT_COMPONENTS FAMILY_ParametersToExcel](filePath=watch, getValues=boolean, categoria=categories)

string_from_object_2 = FromObject(element_types)
code_block_3 = CodeBlock { "."; "_"; }
replace_2 = String.Replace(str=string_from_object_2, searchFor=code_block_3.out0, replaceWith=code_block_3.out1)
code_block_4 = CodeBlock(PERCORSO=directory_path, NOMEFILE=replace_2) { PERCORSO+"\\"+NOMEFILE+".xlsx"; }
watch_2 = Watch(code_block_4)
