# Dynamo graph OT_LOD_exportParameterToSQL_r00.dyn (Dynamo 1.3.2.2480)

# group: FAMIGLIE CARICABILI
categories = Categories("StructuralColumns")
boolean = BoolSelector(true)
string = StringInput("driver={SQL Server};server=NBCAD00\SQLEXPRESS;database=LOD;Trusted_Connection=Yes;")
TABLE = BoolSelector(false)
VALUES = BoolSelector(false)
OT_impFamilies_exportParametersSQL = Custom[OT_impFamilies_exportParametersSQL](categoria=categories, getValues=boolean, connectionString=string, createTableBOOL=TABLE, createValuesBOOL=VALUES)
watch = Watch(OT_impFamilies_exportParametersSQL.SQLTableOut)
watch_2 = Watch(OT_impFamilies_exportParametersSQL.SQLValuesOut)
verifica_caricamento_db = BoolSelector(true)
string_from_object = FromObject(categories)
code_block = CodeBlock { "."; "_"; }
replace = String.Replace(str=string_from_object, searchFor=code_block.out0, replaceWith=code_block.out1)
code_block_2 = CodeBlock(nomeTabella=replace) { "SELECT * FROM DBO."+nomeTabella+"; "; }
watch_3 = Watch(code_block_2)
ODBC_Query = Database.Query.ODBC_Query(string, verifica_caricamento_db, watch_3)
watch_4 = Watch(ODBC_Query)

# group: FAMIGLIE DI SISTEMA
element_types = ElementTypes("Wall")
TABLE_2 = BoolSelector(false)
VALUES_2 = BoolSelector(false)
OT_sysFamilies_exportParametersSQL = Custom[OT_sysFamilies_exportParametersSQL](categoria=element_types, getValues=boolean, connectionString=string, createTableBOOL=TABLE_2, createValuesBOOL=VALUES_2)
watch_5 = Watch(OT_sysFamilies_exportParametersSQL.SQLTableOut)
watch_6 = Watch(OT_sysFamilies_exportParametersSQL.SQLValuesOut)
verifica_caricamento_db_2 = BoolSelector(true)
string_from_object_2 = FromObject(element_types)
code_block_3 = CodeBlock { "."; "_"; }
replace_2 = String.Replace(str=string_from_object_2, searchFor=code_block_3.out0, replaceWith=code_block_3.out1)
code_block_4 = CodeBlock(nomeTabella=replace_2) { "SELECT * FROM DBO."+nomeTabella+"; "; }
watch_7 = Watch(code_block_4)
ODBC_Query_2 = Database.Query.ODBC_Query(string, verifica_caricamento_db_2, watch_7)
watch_8 = Watch(ODBC_Query_2)

# group: DB SQL CONNECTION TEST
boolean_2 = BoolSelector(true)
code_block_5 = CodeBlock { "SELECT * FROM DBO.LOD"; }
ODBC_Query_3 = Database.Query.ODBC_Query(string, boolean_2, code_block_5)
watch_9 = Watch(ODBC_Query_3)
string_2 = StringInput("driver={SQL Server};server=NBCAD00\SQLEXPRESS;database=OTBIMCAT;Trusted_Connection=Yes;")
